# Grasshopper definition 2021-07-29_OpenPoseToGH_2_DS.gh (Grasshopper 1.0.7)
# plug-ins: MetaHopper, treesloth01, Human, Telepathy

# ---- group: Select File
# 1. Set the file to read in
right_click_and_select = FilePath("C:\Users\david\Dropbox\!Maker + ifLAB - ARTWORKS\21_01_ESPLANADE_PERTH\03_CONCEPT STAGE\02_MODEL\01 Scripts\02 Script Outputs\SouthPerth_BlackWhite_Vid 1_1\SouthPerth_BlackWhite_Vid 1_1_Output_2021-07-29-14-02-57.txt")

# ----
image = ImageSampler(Filter="Colour", Interpolate=False, Umax=772, Umin=1, Vmax=438, Vmin=1, Wrap=1)

# ----
# Get text from file
# Use time if running realtime
trigger = Trigger(Interval=5, TimerInterval=5, Target=c_script)  # disabled
join = TextJoin(Text=right_click_and_select)
c_script = CSharpScript(filePath=join)  # -> out, A; inputs filePath: String
# ---------- c_script: C# ----------
    List<double> xList = new List<double>();
    List<double> yList = new List<double>();
    List<double> zList = new List<double>();

    var fs = new System.IO.FileStream(filePath, System.IO.FileMode.Open, System.IO.FileAccess.Read, System.IO.FileShare.ReadWrite);
    using (var sr = new System.IO.StreamReader(fs)) {

     

      while (sr.Peek() >= 0)
      {
         var line = sr.ReadLine();
        
        if (line.Contains("vis"))
        {
          continue;
        }
        if (line.Contains("x:"))
        {
          var x = double.Parse(line.Replace("x:", ""));
          xList.Add(x);
        }
        if (line.Contains("y:"))
        {
          var y = double.Parse(line.Replace("y:", ""));
          yList.Add(y);
        }
        if (line.Contains("z:"))
        {
          var z = double.Parse(line.Replace("z:", ""));
          zList.Add(z);
        }
      }
     

    }



    List<Point3d> points = new List<Point3d>();

    for (int i = 0; i < xList.Count; i++)
    {
      points.Add(new Point3d(xList[i], yList[i], zList[i]));
    }

    A = points;
# ---------- end c_script ----------
pt = Point(c_script.A)

# ---- group: Select Indiviual Frame
number_slider = Slider(29, range=0..962)

# ---- group: Scale points
scale = Scale(Geometry=pt, Center=Point(0, 0, 0), Factor=Slider(1000, range=0..1000))  # -> Geometry, Transform

# ---- group: Select number to offset
# Select number to offset for mutli branch
number_slider_2 = Slider(10, range=0..962)

# ---- group: Plane to orient
xz = XZPlane(Origin=Point(0, 0, 0))
pln = Plane(xz)
orientation_plane = RemoteSender(xz)

# ----
points = Data(scale.Geometry)
avr = Average(Input=points)
xy = XYPlane(Origin=avr)
rotate = Rotate(Geometry=xy, Angle=degrees(Slider(180, range=0..1000)), Plane=xy)  # -> Geometry, Transform
orient = Orient(Geometry=points, Source=rotate.Geometry, Target=pln)  # -> Geometry, Transform
frame_points = RemoteSender(orient.Geometry)

# ---- group: Set the slider domain
frame_points_2 = RemoteReceiver(frame_points)
group = Group(Objects=frame_points_2)  # -> flatten(Group)
lng = ListLength(List=group)
subtraction = Subtraction(A=lng, B="1")
dom = ConstructDomain(DomainStart=0, DomainEnd=subtraction)
range = Range(Domain=dom, Steps=subtraction)
selobj = GetSelectedObjects()  # -> ComponentObjects, graft(ParamObjects), OtherObjects
set_slider = SetSliderProperties(Slider=selobj.ParamObjects, Range=range)

# ----
frame_points_3 = RemoteReceiver(frame_points)
branch = TreeBranch(Tree=simplify(frame_points_3), Path=number_slider, MaintainPaths=True)
selected_frame_points = RemoteSender(branch)

# ---- group: Preview Point Indices
selected_frame_points_2 = RemoteReceiver(selected_frame_points)
number_slider_3 = Slider(39, range=0..100)  # disabled
geo = Geometry(selected_frame_points_2)  # disabled
points_2 = PointList(Points=geo, Size=number_slider_3)  # disabled

# ----
series = Series(Start=0, Step=1, Count=number_slider_2)
addition = Addition(A=number_slider, B=series)

frame_points_4 = RemoteReceiver(frame_points)

branch_2 = TreeBranch(Tree=simplify(frame_points_4), Path=addition, MaintainPaths=True)
multiple_frame_points = RemoteSender(branch_2)

selected_frame_points_3 = RemoteReceiver(selected_frame_points)
orientation_plane_2 = RemoteReceiver(orientation_plane)
del = DelaunayMesh(Points=selected_frame_points_3, Plane=orientation_plane_2)
c_script_2 = CSharpScript(M=del)  # -> out, flatten(A); inputs M: Mesh
# ---------- c_script_2: C# ----------
    A = M.GetNakedEdges();
# ---------- end c_script_2 ----------
previewlw = CustomPreviewLineweights(Geometry=c_script_2.A, Shader=ColourSwatch(SwatchColor=RGB(0, 0, 0)), Thickness=Slider(0, range=0..10), Absolute=False)

# ---- group: Select Points and connect
# Individual Branch
selected_frame_points_4 = RemoteReceiver(selected_frame_points)
data = Data(selected_frame_points_4)
panel = Panel("""19
15
13
11
23
25
27
31""")
panel_2 = Panel("""20
16
14
12
24
26
28
32""")
panel_3 = Panel("""8
6
5
4
0
1
2
3
7""")
item = ListItem(List=data, Index=panel, Wrap=invert(True))
item_2 = ListItem(List=data, Index=panel_2, Wrap=invert(True))
item_3 = ListItem(List=data, Index=panel_3, Wrap=invert(True))
pline = PolyLine(Vertices=item, Closed=False)
pline_2 = PolyLine(Vertices=item_2, Closed=False)
pline_3 = PolyLine(Vertices=item_3, Closed=False)
dots = DotDisplay(Point=data, Colour=ColourSwatch(SwatchColor=RGB(116, 199, 255)), Size=Slider(7, range=0..100))
previewlw_2 = CustomPreviewLineweights(
    Geometry=[pline, pline_2, pline_3],
    Shader=ColourSwatch(SwatchColor=RGB(0, 0, 0)),
    Thickness=Slider(7, range=0..10),
    Absolute=False)

# ---- group: get the boundary of the mesh
multiple_frame_points_2 = RemoteReceiver(multiple_frame_points)
xz_2 = XZPlane(Origin=Point(0, 0, 0))
del_2 = DelaunayMesh(Points=multiple_frame_points_2, Plane=xz_2)
c_script_3 = CSharpScript(M=del_2)  # -> out, flatten(A); inputs M: Mesh; same code as c_script_2
lng_2 = ListLength(List=c_script_3.A)

# ---- group: Input Crv
# Multiple Branch
input_curve = Curve(<curve referenced from the Rhino model>)

# ---- group: Get the perp frames to orient
crv = Curve(input_curve)
divide = DivideCurve(Curve=crv, Count=lng_2, Kinks=False)  # -> Points, Tangents, Parameters
pframe = PerpFrame(Curve=crv, Parameter=divide.Parameters)  # -> graft(Frame)

# ---- group: Get the last item to draw person on
multiple_frame_points_3 = RemoteReceiver(multiple_frame_points)
orientation_plane_3 = RemoteReceiver(orientation_plane)
orient_2 = Orient(Geometry=multiple_frame_points_3, Source=orientation_plane_3, Target=pframe)  # -> Geometry, Transform
group_2 = Group(Objects=orient_2.Geometry)
first_last = FirstLast(List=flatten(group_2))  # -> FirstValue, LastValue
first_last_2 = FirstLast(List=flatten(pframe))  # -> FirstValue, LastValue
ungroup = Ungroup(Group=first_last.LastValue)

# ---- group: Connect with nurbs curve
flip = FlipMatrix(Data=orient_2.Geometry)
nurbs = NurbsCurve(Vertices=flip, Degree=3, Periodic=False)  # -> Curve, Length, Domain
previewlw_3 = CustomPreviewLineweights(
    Geometry=nurbs.Curve,
    Shader=ColourSwatch(SwatchColor=RGB(199, 199, 199)),
    Thickness=Slider(2, range=0..10),
    Absolute=False)

# ---- group: Select Points and connect
data_2 = Data(orient_2.Geometry)
dots_2 = DotDisplay(Point=data_2, Colour=ColourSwatch(SwatchColor=RGB(116, 199, 255)), Size=Slider(3, range=0..100))
panel_4 = Panel("""19
15
13
11
23
25
27
31""")
panel_5 = Panel("""20
16
14
12
24
26
28
32""")
panel_6 = Panel("""8
6
5
4
0
1
2
3
7""")
item_4 = ListItem(List=data_2, Index=panel_4, Wrap=invert(True))
item_5 = ListItem(List=data_2, Index=panel_5, Wrap=invert(True))
item_6 = ListItem(List=data_2, Index=panel_6, Wrap=invert(True))
pline_4 = PolyLine(Vertices=item_4, Closed=False)
pline_5 = PolyLine(Vertices=item_5, Closed=False)
pline_6 = PolyLine(Vertices=item_6, Closed=False)
previewlw_4 = CustomPreviewLineweights(
    Geometry=[pline_4, pline_5, pline_6],
    Shader=ColourSwatch(SwatchColor=RGB(0, 0, 0)),
    Thickness=Slider(1, range=0..10),
    Absolute=False)

data_3 = Data(ungroup)
dots_3 = DotDisplay(Point=data_3, Colour=ColourSwatch(SwatchColor=RGB(116, 199, 255)), Size=Slider(6, range=0..100))
panel_7 = Panel("""19
15
13
11
23
25
27
31""")
panel_8 = Panel("""20
16
14
12
24
26
28
32""")
panel_9 = Panel("""8
6
5
4
0
1
2
3
7""")
item_7 = ListItem(List=data_3, Index=panel_7, Wrap=invert(True))
item_8 = ListItem(List=data_3, Index=panel_8, Wrap=invert(True))
item_9 = ListItem(List=data_3, Index=panel_9, Wrap=invert(True))
pline_7 = PolyLine(Vertices=item_7, Closed=False)
pline_8 = PolyLine(Vertices=item_8, Closed=False)
pline_9 = PolyLine(Vertices=item_9, Closed=False)
previewlw_5 = CustomPreviewLineweights(
    Geometry=[pline_7, pline_8, pline_9],
    Shader=ColourSwatch(SwatchColor=RGB(0, 0, 0)),
    Thickness=Slider(7, range=0..10),
    Absolute=False)

# ---- group: Draw outline
del_3 = DelaunayMesh(Points=ungroup, Plane=first_last_2.LastValue)
c_script_4 = CSharpScript(M=del_3)  # -> out, flatten(A); inputs M: Mesh; same code as c_script_2
previewlw_6 = CustomPreviewLineweights(Geometry=c_script_4.A, Shader=ColourSwatch(SwatchColor=RGB(0, 0, 0)), Thickness=Slider(1, range=0..10), Absolute=False)

# ---- group: Create a srf through curces
geo_2 = Geometry(flatten(pline_4))
geo_3 = Geometry(flatten(pline_6))
geo_4 = Geometry(flatten(pline_5))
loft = Loft(
    Curves=flatten([geo_2, geo_4, geo_3]),
    Options={Adjust=False, Closed=False, LoftEnds=0, LoftSimp=0, LoftType=0, Rebuild=10, Refit=0.01})  # disabled
